# Dynamo graph Check json Topology.dyn (Dynamo 3.5.2.8914)
# packages: Topologic 1.4.0

file_path = Filename(".\topologic.JSON")
python_script = Python(IN[0]=file_path)  # CPython3
# ---------- python_script.python (28 lines) ----------
import json
import clr
clr.AddReference('ProtoGeometry')
from Autodesk.DesignScript.Geometry import Point, Line

# IN[0] = path to the JSON file
json_path = IN[0]

# Read and parse JSON
with open(json_path, 'r') as f:
    data = json.load(f)

vertices = data["vertices"]
edges = data["edges"]

# Create Dynamo points for each vertex
points = [Point.ByCoordinates(*v) for v in vertices]

# Create lines for each edge
lines = []
for e in edges:
    i, j = e
    p1 = points[i]
    p2 = points[j]
    lines.append(Line.ByStartPointEndPoint(p1, p2))

# Output points and lines to Dynamo
OUT = points, lines
# ----------------------------------------
byGeometry = Topologic.Topology.ByGeometry(geometry=python_script)
byTopologies = Topologic.Cluster.ByTopologies(topologies=byGeometry)
selfMerge = Topologic.Topology.SelfMerge(topology=byTopologies)
wires = Topologic.Topology.Wires(topology=selfMerge)
